% Simulink data dictionary My_PID_parameter.sldd

Q_KP = Simulink.Parameter(2.19, StorageClass="Struct", StructName="MY_PID", DataType="single")
D_KP = Simulink.Parameter(2.19, StorageClass="Struct", StructName="MY_PID", DataType="single")
D_KI = Simulink.Parameter(1650, StorageClass="Struct", StructName="MY_PID", DataType="single")
Q_Upper_lower = Simulink.Parameter([20000 -20000], StorageClass="ExportedGlobal", DataType="single")
D_Upper_lower = Simulink.Parameter([20000 -20000], StorageClass="ExportedGlobal", DataType="single")
SPEED_PI_KB = Simulink.Parameter(0.15, StorageClass="Struct", StructName="SPEED_Struct", DataType="single")
SPEED_PI_LOW_LIMIT = Simulink.Parameter(-5, StorageClass="ExportedGlobal", DataType="single")
SPEED_PI_UP_LIMIT = Simulink.Parameter(5, StorageClass="ExportedGlobal", DataType="single")
Q_KI = Simulink.Parameter(1650, StorageClass="Struct", StructName="MY_PID", DataType="single")
OUT_limits = Simulink.Parameter([24 -24], StorageClass="ExportedGlobal", DataType="single")
OUT_Upper = Simulink.Parameter(24, StorageClass="ExportedGlobal", DataType="single")
OUT_Lower = Simulink.Parameter(-24, StorageClass="ExportedGlobal", DataType="single")
Ld = 0.000558
Lq = 0.000558
PI = 3.1415926
Pn = 4
R = 0.6
Ts = 0.0001
flux = 0.00572
SPEED_PI_I = Simulink.Parameter(3, StorageClass="Struct", StructName="SPEED_Struct", DataType="single")
SPEED_PI_P = Simulink.Parameter(0.02, StorageClass="Struct", StructName="SPEED_Struct", DataType="single")